% Simulink data dictionary ElectricPowertrain_data.sldd

ControllerCmds_BUS = Simulink.Bus()
  ContactorsCmds: Bus: ContactorsCmds_BUS

PhysicalInputs_BUS = Simulink.Bus()
  BServiceDisconnectPos: boolean
  BServiceDisconnectNeg: boolean

rInitialSoC = Simulink.Parameter(repmat(65, 1, 228), DataType="double")
rCellCapacity = Simulink.Parameter(repmat(4, 1, 228), DataType="double")

PlantOutput_BUS = Simulink.Bus()
  VCUKIVT: double
  VESDCLink: double
  VESIVT: double
  BContactorsClosed: boolean

DriverCmds_BUS = Simulink.Bus()
  BStartSwitch: boolean
  BDrive: boolean

ContactorsCmds_BUS = Simulink.Bus()
  BContPosRequested: boolean
  BContNegRequested: boolean
  BPrechargeRequested: boolean
  BActiveDischargeRequested: boolean

BServiceDisconnectNeg = Simulink.Parameter(true, DataType="boolean")
BServiceDisconnectPos = Simulink.Parameter(true, DataType="boolean")
tSim = Simulink.Parameter(0.001)
BDrive = Simulink.Parameter(false, DataType="boolean")
tActiveDischargeDelay = Simulink.Parameter(2)
tCloseContDelay = Simulink.Parameter(0.2)
BStartSwitch = Simulink.Parameter(false, DataType="boolean")